# Grasshopper definition bamboo_structure_project_Pouya_Khazaeli_Parsa.gh (Grasshopper 0.9.76)

# https://www.youtube.com/watch?v=KZJSonmNnPo
number_slider = Slider(227, range=0..1000)
dom = ConstructDomain(DomainStart=number_slider, DomainEnd=1)
number_slider_2 = Slider(2.4, range=0..100)
number_slider_3 = Slider(24, range=0..100)
range = Range(Domain=dom, Steps=expr("x-1", number_slider_3))
xz = XZPlane(Origin=Point(0, 0, 0))
rot3d = Rotate3D(Geometry=xz, Angle=degrees(range), Center=Point(0, 0, 0), Axis=Vector(0, 0, 1))  # -> Geometry, Transform
series = Series(Start=Slider(40.4, range=0..100), Step=number_slider_2, Count=number_slider_3)
arc = Arc(Plane=rot3d.Geometry, Radius=series, Angle=Domain(0, 3.141592654))  # -> Arc, Length
pipe = Pipe(Curve=arc.Arc, Radius=expr("x/2", number_slider_2), Caps=0)
loft = Loft(Curves=arc.Arc, Options={Adjust=False, Closed=False, LoftEnds=0, LoftSimp=0, LoftType=0, Rebuild=10, Refit=0.01})
preview = CustomPreview(Geometry=pipe, Shader=ColourSwatch(SwatchColor=RGB(197, 235, 47)))
preview_2 = CustomPreview(Geometry=loft, Shader=ColourSwatch(SwatchColor=RGBA(222, 220, 220, 202)))
