# Grasshopper definition bamboo_structure_project_Pouya_Khazaeli_Parsa_py.gh (Grasshopper 0.9.76)
# plug-ins: Python Interpreter

# https://www.youtube.com/watch?v=KZJSonmNnPo
number_slider = Slider(227, range=0..1000)
dom = ConstructDomain(DomainStart=number_slider, DomainEnd=1)
number_slider_2 = Slider(40.4, range=0..100)
number_slider_3 = Slider(2.4, range=0..100)
number_slider_4 = Slider(24, range=0..100)
range = Range(Domain=dom, Steps=expr("x-1", number_slider_4))
xz = XZPlane(Origin=Point(0, 0, 0))
xz_2 = XZPlane(Origin=Point(0, 0, 0))
# Help on method-descriptor Rotate
# 
#  |  Rotate(...)
#  |          Rotate(self: Plane, angle: float, axis: Vector3d, centerOfRotation: Point3d) -> bool
#  |
#  |              Rotate the plane about a custom anchor point.
#  |
#  |              angle: Angle in radians.
#  |              axis: Axis of rotation.
#  |              centerOfRotation: Center of rotation.
#  |              Returns: true on success, false on failure.
#  |          Rotate(self: Plane, sinAngle: float, cosAngle: float, axis: Vector3d, centerOfRotation: Point3d) -> bool
#  |
#  |              Rotate the plane about a custom anchor point.
#  |
#  |              sinAngle: Sin(angle)
#  |              cosAngle: Cos(angle)
#  |              axis: Axis of rotation.
#  |              centerOfRotation: Center of rotation.
#  |              Returns: true on success, false on failure.
#  |          Rotate(self: Plane, sinAngle: float, cosAngle: float, axis: Vector3d) -> bool
#  |
#  |              Rotate the plane about its origin point.
#  |
#  |              sinAngle: Sin(angle).
#  |              cosAngle: Cos(angle).
#  |              axis: Axis of rotation.
#  |              Returns: true on success, false on failure.
#  |          Rotate(self: Plane, angle: float, axis: Vector3d) -> bool
#  |
#  |              Rotate the plane about its origin point.
#  |
#  |              angle: Angle in radians.
#  |              axis: Axis of rotation.
#  |              Returns: true on success, false on failure.
#  |
xz_3 = XZPlane(Origin=Point(0, 0, 0))
rot3d = Rotate3D(Geometry=xz, Angle=degrees(range), Center=Point(0, 0, 0), Axis=Vector(0, 0, 1))  # -> Geometry, Transform
series = Series(Start=number_slider_2, Step=number_slider_3, Count=number_slider_4)
python = PythonScript(plane=xz_2, start=number_slider_2, step=number_slider_3, count=number_slider_4)  # -> out, arc; inputs plane: Plane, count: Int32
# ---------- python: Python ----------
"""
tarefas:
1 - criar uma lista Rotate3D;
2 - criar uma lsita tipo 'Serie';
3 - criar um arc;
4 - pipe;
5 - loft


"""

import rhinoscriptsyntax as rs
import Rhino 

#plane = Rhino.Geometry.Plane.WorldZX #não tem XZ

#Rhino.Geometry.Plane.Rotate(

arc = rs.AddArc(plane, start, 180.0)
# ---------- end python ----------
python_2 = PythonScript(plane=xz_3, start=number_slider_2, step=number_slider_3, count=number_slider_4)  # -> out, arc; inputs plane: Plane, count: Int32
# ---------- python_2: Python ----------
"""
tarefas:
1 - criar uma lista Rotate3D;
2 - criar uma lsita tipo 'Serie';
3 - criar um arc;
4 - pipe;
5 - loft


"""

import rhinoscriptsyntax as rs
import Rhino 

arc = rs.AddArc(plane, start, 180.0)
# ---------- end python_2 ----------
arc = Arc(Plane=rot3d.Geometry, Radius=series, Angle=Domain(0, 3.141592654))  # -> Arc, Length
panel = Panel(rot3d.Geometry)
pipe = Pipe(Curve=arc.Arc, Radius=expr("x/2", number_slider_3), Caps=0)
loft = Loft(Curves=arc.Arc, Options={Adjust=False, Closed=False, LoftEnds=0, LoftSimp=0, LoftType=0, Rebuild=10, Refit=0.01})
preview = CustomPreview(Geometry=pipe, Shader=ColourSwatch(SwatchColor=RGB(197, 235, 47)))
panel_2 = Panel(series)
preview_2 = CustomPreview(Geometry=loft, Shader=ColourSwatch(SwatchColor=RGBA(222, 220, 220, 202)))
