# Grasshopper definition camboo_pavilion.gh (Grasshopper 1.0.7)
# plug-ins: LunchBox

# Enneper Surface
# 
# https://en.wikipedia.org/wiki/Enneper_surface
# 
# ref.: https://www.youtube.com/watch?v=pqgif8uRzmI&list=PLwO_FSSNwNi7QDNTIgOctumQcxZtX8qjK&index=15
number_slider = Slider(100, range=0..100)
enneper = EnneperSurface(
    UDivisions=number_slider,
    VDivisions=number_slider,
    RParameter=3,
    Scale=15,
    Domain1=Domain(0, 1),
    Domain2=Domain(-3.141592654, 3.141592654))

# ---- group: Implantação do modelo
bbox = BoundingBox(Content=enneper, Plane=PlaneXY(0, 0, 0))  # -> Box, Box_2
debox = DeconstructBox(Box=bbox.Box)  # -> Plane, X, Y, Z
dedomain = DeconstructDomain(Domain=debox.Z)  # -> Start, End
Z = UnitZ(Factor=dedomain.End)
move = Move(Geometry=enneper, Motion=Z)  # -> Geometry, Transform

# ----
divide = DivideDomain²(Domain=move.Geometry, UCount=Slider(14, range=0..100), VCount=Slider(60, range=0..100))
subsrf = Isotrim(Surface=move.Geometry, Domain=divide)
panel = Panel(move.Geometry)
panel_2 = Panel(divide)
panel_3 = Panel(subsrf)
debrep = DeconstructBrep(Brep=subsrf)  # -> Faces, Edges, Vertices
item = ListItem(List=debrep.Edges, Index=0, Wrap=True)  # -> Item, Item1

# ---- group: Curvas transversais
crv = Curve(item.Item)

# ---- group: Curvas longitudinais
crv_2 = Curve(item.Item1)

# ---- group: curvas fragmentadas
viewer = ParamViewer(crv)

# ----
join = JoinCurves(Curves=flatten(crv), Preserve=False)
join_2 = JoinCurves(Curves=flatten(crv_2), Preserve=False)

# ---- group: curvas unidas
viewer_2 = ParamViewer(join)

# ----
pipe = Pipe(Curve=join_2, Radius=Slider(0.1, range=0..0.1), Caps=0)
pipe_2 = Pipe(Curve=join, Radius=Slider(0.1, range=0..0.1), Caps=0)
srf = Surface(debrep.Faces)
