# Grasshopper definition catenary_structure_pavilion.gh (Grasshopper 0.9.76)

number_slider = Slider(360, range=0..360)
number_slider_2 = Slider(180, range=0..360)
# https://www.youtube.com/watch?v=ORMxJ_CMKfY
number_slider_3 = Slider(0, range=0..100)
number_slider_4 = Slider(100, range=0..100)
subtraction = Subtraction(A=number_slider, B=number_slider_2)
dom = ConstructDomain(DomainStart=number_slider_3, DomainEnd=number_slider_2)
dom_2 = ConstructDomain(DomainStart=number_slider, DomainEnd=subtraction)
xy = XYPlane(Origin=Point(0, 0, 0))
rad = Radians(Degrees=dom_2)
rad_2 = Radians(Degrees=dom)
arc = Arc(Plane=xy, Radius=expr("x/2", number_slider_4), Angle=rad)  # -> Arc, Length
number_slider_5 = Slider(30, range=0..100)
arc_2 = Arc(Plane=xy, Radius=number_slider_4, Angle=rad_2)  # -> Arc, Length
divide = DivideCurve(Curve=arc_2.Arc, Count=number_slider_5, Kinks=False)  # -> Points, Tangents, Parameters
divide_2 = DivideCurve(Curve=arc.Arc, Count=number_slider_5, Kinks=False)  # -> reverse(Points), Tangents, Parameters
dom_3 = ConstructDomain(DomainStart=Slider(1.3, range=0..10), DomainEnd=Slider(2.1, range=0..10))
ln = Line(StartPoint=divide.Points, EndPoint=divide_2.Points)
len = Length(Curve=ln)
range = Range(Domain=dom_3, Steps=number_slider_5)
multiplication = Multiplication(A=len, B=range)
Z = UnitZ(Factor=1)
cat = Catenary(PointA=divide.Points, PointB=divide_2.Points, Length=multiplication, Gravity=Z)
number_slider_6 = Slider(2, range=0..10)
loft = Loft(Curves=cat, Options={Adjust=False, Closed=False, LoftEnds=0, LoftSimp=0, LoftType=0, Rebuild=10, Refit=0.01})
pipe = Pipe(Curve=[arc_2.Arc, arc.Arc], Radius=Slider(0.6, range=0..1), Caps=number_slider_6)
pipe_2 = Pipe(Curve=cat, Radius=Slider(0.3, range=0..1), Caps=number_slider_6)
preview = CustomPreview(Geometry=loft, Shader=ColourSwatch(SwatchColor=RGBA(255, 255, 255, 153)))
preview_2 = CustomPreview(Geometry=[pipe_2, pipe], Shader=ColourSwatch(SwatchColor=RGB(255, 240, 25)))
