# Grasshopper definition verification-model-bamboo_truss.gh (Grasshopper 1.0.7)
# plug-ins: karambaGH

step_between_web_elts_m = Panel("0.75")
nb_of_steps_odd_nb = Panel("4")
# Ref.: https://www.grasshopper3d.com/group/karamba3d/forum/topics/innovative-bamboo-truss-modeling-problems
interaxis_dist_of_flange_elts_m = Panel("0.40")
multiplication = Multiplication(A=step_between_web_elts_m, B=nb_of_steps_odd_nb)
pt = ConstructPoint(XCoordinate=0, YCoordinate=0, ZCoordinate=0)
X = UnitX(Factor=multiplication)
move = Move(Geometry=pt, Motion=X)  # -> Geometry, Transform
# GEOMETRY DEFINITON
# DO AN INDEXED POINTS GEOMETRY FOR LATER ON
Z = UnitZ(Factor=interaxis_dist_of_flange_elts_m)
ln = Line(StartPoint=pt, EndPoint=move.Geometry)
move_2 = Move(Geometry=ln, Motion=Z)  # -> Geometry, Transform
entwine = Entwine(Branch00=move_2.Geometry, Branch01=ln, FlattenInputs=True)
divide = DivideCurve(Curve=entwine, Count=nb_of_steps_odd_nb, Kinks=False)  # -> simplify(Points), Tangents, Parameters
bang = ExplodeTree(Data=divide.Points)  # -> Branch0, Branch1
lng = ListLength(List=bang.Branch0)
integer_division = IntegerDivision(A=lng, B="2")
mod = Modulus(A=lng, B="2")
addition = Addition(A=integer_division, B=mod)
subtraction = Subtraction(A=lng, B="1", C="1")
split = SplitList(List=bang.Branch0, Index=integer_division)  # -> ListA, ListB
split_2 = SplitList(List=bang.Branch1, Index=integer_division)  # -> ListA, ListB
split_3 = SplitList(List=bang.Branch0, Index=addition)  # -> ListA, ListB
split_4 = SplitList(List=bang.Branch1, Index=addition)  # -> ListA, ListB
# CONTROLS
dom = ConstructDomain(DomainStart="1", DomainEnd=subtraction)
shatter = Shatter(Curve=entwine, Parameters=divide.Parameters)
shift = ShiftList(List=split.ListB, Shift=1, Wrap=False)
shift_2 = ShiftList(List=split_4.ListA, Shift=1, Wrap=False)
bang_2 = ExplodeTree(Data=simplify(shatter))  # -> Branch0, Branch1
short = ShortestList(ListA=shift, ListB=split_2.ListB, TrimMode=2)  # -> ListA, ListB
first_last_elt = FirstLastElt(L=bang_2.Branch1)
short_2 = ShortestList(ListA=split_3.ListA, ListB=shift_2, TrimMode=2)  # -> ListA, ListB
subset = SubList(List=bang.Branch0, Domain=dom, Wrap=True)  # -> List, Index
subset_2 = SubList(List=bang.Branch1, Domain=dom, Wrap=True)  # -> List, Index
ln_2 = Line(StartPoint=short.ListA, EndPoint=short.ListB)
dispatch = Dispatch(List=bang_2.Branch1, DispatchPattern=first_last_elt)  # -> ListA, ListB
ln_3 = Line(StartPoint=short_2.ListA, EndPoint=short_2.ListB)
ln_4 = Line(StartPoint=subset.List, EndPoint=subset_2.List)
entwine_2 = Entwine(Branch00=ln_3, Branch01=ln_2, FlattenInputs=True)  # -> flatten(Result)
curvepoint = PointOnCurve(entwine_2, parameter=0.5)
pdecon = Deconstruct(Point=curvepoint)  # -> XComponent, YComponent, ZComponent
sort = SortList(Keys=pdecon.XComponent, ValuesA=entwine_2)  # -> Keys, ValuesA
first_last_elt_2 = FirstLastElt(L=sort.ValuesA)
dispatch_2 = Dispatch(List=sort.ValuesA, DispatchPattern=first_last_elt_2)  # -> ListA, ListB

young_s_modulus_e_mpa_gak_according_to_n = Panel("9500")  # "Young's Modulus E (MPa) - GaK according to NSR=10"

# ----
# Pas sûr du tout pour l'orthotropic ...
transverse_shear_modulus_g13_g23_g3_mpa = Panel("351")  # "Transverse Shear Modulus G13=G23=G3 (MPa) - GaK"
gravitational_acceleration_g_m_s2_as_def = Panel("10.0")  # "Gravitational acceleration g (m/s2) as defined in karamba.ini"
mpa_to_kn_cm2_conversion_factor = Panel("0.1")
yield_strength_in_compression_f_cy_mpa_g = Panel("20")  # "Yield strength (in compression) f_cy (MPa) - GaK"
# MATERIAL DEFINITION
# Values from  Moran et al., 2017
# coordinate system: 1,2,3 = radial, circumferential, axial
young_s_modulus_e1_e2_et_mpa_gak = Panel("860")
in_plane_shear_modulus_g12_mpa_gak = Panel("581")
young_s_modulus_e3_el_mpa_gak = Panel("13450")
specific_weight_kg_m3_b_blumeana = Panel("570")
specific_weight_kg_m3_gak = Panel("700")
n_to_kn_conversion_factor = Panel("0.001")
multiplication_2 = Multiplication(A=young_s_modulus_e3_el_mpa_gak, B=mpa_to_kn_cm2_conversion_factor)
multiplication_3 = Multiplication(A=in_plane_shear_modulus_g12_mpa_gak, B=mpa_to_kn_cm2_conversion_factor)
multiplication_4 = Multiplication(A=transverse_shear_modulus_g13_g23_g3_mpa, B=mpa_to_kn_cm2_conversion_factor)
multiplication_5 = Multiplication(A=yield_strength_in_compression_f_cy_mpa_g, B=mpa_to_kn_cm2_conversion_factor)
multiplication_6 = Multiplication(A=young_s_modulus_e1_e2_et_mpa_gak, B=mpa_to_kn_cm2_conversion_factor)
multiplication_7 = Multiplication(A=specific_weight_kg_m3_gak, B=gravitational_acceleration_g_m_s2_as_def, C=n_to_kn_conversion_factor)
poisson_ratio_nu13_nu23_gak = Panel("0.01")
poisson_ratio_nu12_gak = Panel("0.22")
swatch = ColourSwatch(SwatchColor=RGB(214, 224, 94))
matprops = MaterialPropertiesKaramba3D(
    FamilyOfMaterial="bamboo",
    Name="GaK-ortho",
    Color=swatch,
    YoungsModulusKNCm2Dir1=multiplication_6,
    YoungsModulusKNCm2Dir2=multiplication_2,
    InPlaneShearModulus_kN_cm2=multiplication_3,
    InPlaneLateralContractionCoefficient=poisson_ratio_nu12_gak,
    TransverseShearModulusKNCm2Dir1=multiplication_4,
    TransverseShearModulusKNCm2Dir2=multiplication_4,
    SpecificWeight_kN_m3=multiplication_7,
    CoefficientOfThermalExpansion1CDir1=1e-05,
    CoefficientOfThermalExpansion1CDir2=1e-05,
    YieldStrengthKNCm2Dir1=multiplication_5,
    YieldStrengthKNCm2Dir2=23.5,
    mode="Orthotropic")
matprops_2 = MaterialPropertiesKaramba3D(
    FamilyOfMaterial="bamboo",
    Name="GaK-iso",
    Color=swatch,
    YoungsModulus_kN_cm2=multiplication_2,
    InPlaneShearModulus_kN_cm2=multiplication_3,
    TransverseShearModulus_kN_cm2=multiplication_4,
    SpecificWeight_kN_m3=multiplication_7,
    CoefficientOfThermalExpansion_1_C=1e-05,
    YieldStrength_kN_cm2=multiplication_5,
    mode="Isotrop")
material = MaterialKaramba3D(matprops)

# ----
# Values from Khatry & Mishra, 2012
# cartesian coordinates (x is the axial coordinate)
gravitational_acceleration_g_m_s2_as_def_2 = Panel("10.0")  # "Gravitational acceleration g (m/s2) as defined in karamba.ini"
mpa_to_kn_cm2_conversion_factor_2 = Panel("0.1")
yield_strength_in_compression_f_cy_mpa = Panel("79")
young_s_modulus_ex_mpa = Panel("15000")
young_s_modulus_ey_mpa = Panel("477")
shear_modulus_gxz_mpa = Panel("237")
young_s_modulus_ez_mpa = Panel("477")
shear_modulus_gyz_mpa = Panel("7500")
shear_modulus_gxy_mpa = Panel("237")
poisson_ratio_nu12 = Panel("0.3")
specific_weight_kg_m3 = Panel("710")
n_to_kn_conversion_factor_2 = Panel("0.001")
multiplication_8 = Multiplication(A=specific_weight_kg_m3, B=gravitational_acceleration_g_m_s2_as_def_2, C=n_to_kn_conversion_factor_2)
multiplication_9 = Multiplication(A=shear_modulus_gxz_mpa, B=mpa_to_kn_cm2_conversion_factor_2)
multiplication_10 = Multiplication(A=yield_strength_in_compression_f_cy_mpa, B=mpa_to_kn_cm2_conversion_factor_2)
multiplication_11 = Multiplication(A=young_s_modulus_ez_mpa, B=mpa_to_kn_cm2_conversion_factor_2)
multiplication_12 = Multiplication(A=shear_modulus_gxy_mpa, B=mpa_to_kn_cm2_conversion_factor_2)
multiplication_13 = Multiplication(A=shear_modulus_gyz_mpa, B=mpa_to_kn_cm2_conversion_factor_2)
multiplication_14 = Multiplication(A=young_s_modulus_ex_mpa, B=mpa_to_kn_cm2_conversion_factor_2)
multiplication_15 = Multiplication(A=young_s_modulus_ey_mpa, B=mpa_to_kn_cm2_conversion_factor_2)
matprops_3 = MaterialPropertiesKaramba3D(
    FamilyOfMaterial="bamboo",
    Name="GaK-ortho",
    Color=swatch,
    YoungsModulusKNCm2Dir1=multiplication_14,
    YoungsModulusKNCm2Dir2=multiplication_15,
    InPlaneShearModulus_kN_cm2=multiplication_12,
    InPlaneLateralContractionCoefficient=poisson_ratio_nu12,
    TransverseShearModulusKNCm2Dir1=multiplication_9,
    TransverseShearModulusKNCm2Dir2=multiplication_13,
    SpecificWeight_kN_m3=multiplication_8,
    CoefficientOfThermalExpansion1CDir1=1e-05,
    CoefficientOfThermalExpansion1CDir2=1e-05,
    YieldStrengthKNCm2Dir1=multiplication_10,
    YieldStrengthKNCm2Dir2=23.5,
    mode="Orthotropic")

# ----
# Values from Chand, Shukla and Sharma, 2008
gravitational_acceleration_g_m_s2_as_def_3 = Panel("10.0")  # "Gravitational acceleration g (m/s2) as defined in karamba.ini"
mpa_to_kn_cm2_conversion_factor_3 = Panel("0.1")
yield_strength_in_compression_f_cy_mpa_2 = Panel("79")
young_s_modulus_e1_mpa = Panel("360")
young_s_modulus_e2_e3_mpa = Panel("36")
shear_modulus_g13_mpa = Panel("121")
young_s_modulus_e3_mpa = Panel("36")
shear_modulus_g23_mpa = Panel("12.63")
shear_modulus_g12_mpa = Panel("121")
poisson_ratio_nu12_2 = Panel("0.48")
specific_weight_kg_m3_2 = Panel("710")
n_to_kn_conversion_factor_3 = Panel("0.001")
multiplication_16 = Multiplication(A=specific_weight_kg_m3_2, B=gravitational_acceleration_g_m_s2_as_def_3, C=n_to_kn_conversion_factor_3)
multiplication_17 = Multiplication(A=shear_modulus_g13_mpa, B=mpa_to_kn_cm2_conversion_factor_3)
multiplication_18 = Multiplication(A=yield_strength_in_compression_f_cy_mpa_2, B=mpa_to_kn_cm2_conversion_factor_3)
multiplication_19 = Multiplication(A=young_s_modulus_e3_mpa, B=mpa_to_kn_cm2_conversion_factor_3)
multiplication_20 = Multiplication(A=shear_modulus_g12_mpa, B=mpa_to_kn_cm2_conversion_factor_3)
multiplication_21 = Multiplication(A=shear_modulus_g23_mpa, B=mpa_to_kn_cm2_conversion_factor_3)
multiplication_22 = Multiplication(A=young_s_modulus_e1_mpa, B=mpa_to_kn_cm2_conversion_factor_3)
multiplication_23 = Multiplication(A=young_s_modulus_e2_e3_mpa, B=mpa_to_kn_cm2_conversion_factor_3)
matprops_4 = MaterialPropertiesKaramba3D(
    FamilyOfMaterial="bamboo",
    Name="GaK-ortho",
    Color=swatch,
    YoungsModulusKNCm2Dir1=multiplication_22,
    YoungsModulusKNCm2Dir2=multiplication_23,
    InPlaneShearModulus_kN_cm2=multiplication_20,
    InPlaneLateralContractionCoefficient=poisson_ratio_nu12_2,
    TransverseShearModulusKNCm2Dir1=multiplication_17,
    TransverseShearModulusKNCm2Dir2=multiplication_21,
    SpecificWeight_kN_m3=multiplication_16,
    CoefficientOfThermalExpansion1CDir1=1e-05,
    CoefficientOfThermalExpansion1CDir2=1e-05,
    YieldStrengthKNCm2Dir1=multiplication_18,
    YieldStrengthKNCm2Dir2=23.5,
    mode="Orthotropic")

young_s_modulus_e1_e2_et_mpa_adapted = Panel("1680")
subdivision_of_chords_culms = Slider(5, range=1..30)
subdivision_of_webs_slats = Slider(5, range=1..30)

# ---- group: 0=combined slats, 1=individual slats
number_slider = Slider(0, range=0..1)

# ---- group: Web-diag-ends
line = Line(dispatch_2.ListA)

# ---- group: Chord - top
line_2 = Line(bang_2.Branch0)

# ---- group: Chord - bottom
line_3 = Line(dispatch.ListB)

# ---- group: Webs-diag-mid
line_4 = Line(dispatch_2.ListB)

# ---- group: Web-vert
line_5 = Line(ln_4)

# ---- group: Check line frame orientation
crv = Curve()  # disabled
crvdom = CurveDomain(Curve=crv)  # -> Curve, Domain; disabled
panel = Panel("-2")  # disabled
dedomain = DeconstructDomain(Domain=crvdom.Domain)  # -> Start, End; disabled
pt_2 = ConstructPoint(XCoordinate=panel, YCoordinate=panel, ZCoordinate=0)  # disabled
subtraction_2 = Subtraction(A=dedomain.End, B=dedomain.Start)  # disabled
panel_2 = Panel("2")  # disabled
xy = XYPlane(Origin=pt_2)  # disabled
division = Division(A=subtraction_2, B=panel_2)  # disabled
frame = CurveFrame(Curve=crv, Parameter=division)  # disabled

# ----
divide_2 = DivideCurve(Curve=line_5, Count=subdivision_of_webs_slats, Kinks=False)  # -> Points, Tangents, Parameters
divide_3 = DivideCurve(Curve=line_4, Count=subdivision_of_webs_slats, Kinks=False)  # -> Points, Tangents, Parameters
divide_4 = DivideCurve(Curve=line, Count=subdivision_of_webs_slats, Kinks=False)  # -> Points, Tangents, Parameters
divide_5 = DivideCurve(Curve=line_2, Count=subdivision_of_chords_culms, Kinks=False)  # -> Points, Tangents, Parameters
divide_6 = DivideCurve(Curve=line_3, Count=subdivision_of_chords_culms, Kinks=False)  # -> Points, Tangents, Parameters
shatter_2 = Shatter(Curve=graft(line_5), Parameters=divide_2.Parameters)
shatter_3 = Shatter(Curve=graft(line_4), Parameters=divide_3.Parameters)
shatter_4 = Shatter(Curve=graft(line), Parameters=divide_4.Parameters)
shatter_5 = Shatter(Curve=graft(line_2), Parameters=divide_5.Parameters)
shatter_6 = Shatter(Curve=graft(line_3), Parameters=divide_6.Parameters)

# ---- group: Web-vert
line_6 = Line(simplify(shatter_2))

# ---- group: Web-diag-mid
line_7 = Line(simplify(shatter_3))

# ---- group: Web-diag-ends
line_8 = Line(simplify(shatter_4))

# ---- group: Chord-top
line_9 = Line(simplify(shatter_5))

# ---- group: Chord-bottom
line_10 = Line(simplify(shatter_6))

# ----
# SUPPORTS DEFINITION
pt_3 = Point(bang.Branch0)

# ----
# Fixed hinge at start
# Moving hinge at end
first_last_elt_3 = FirstLastElt(L=pt_3)
dispatch_3 = Dispatch(List=pt_3, DispatchPattern=first_last_elt_3)  # -> ListA, ListB
item = ListItem(List=dispatch_3.ListA, Index=0, Wrap=True)  # -> Item, Item1
xy_2 = XYPlane(Origin=Point(0, 0, 0))
supp = SupportKaramba3D(PosInd=item.Item, PlaneOfReference=xy_2, menu=[buttons(on, on, on, on, off, off)])
supp_2 = SupportKaramba3D(PosInd=item.Item1, PlaneOfReference=xy_2, menu=[buttons(off, on, on, on, off, off)])
support = SupportKaramba3D([supp_2, supp])

# ----
# G = Gravity (dead load) for all Load Cases
panel_3 = Panel("0")
series = Series(Start=panel_3, Step=1, Count="14")  # -> simplify(Series)

material_2 = MaterialKaramba3D(flatten(material))
support_2 = SupportKaramba3D(flatten(support))
material_3 = MaterialKaramba3D(flatten(material))
joint = JointKaramba3D()
support_3 = SupportKaramba3D(flatten(support))

# ---- group: Calculate Buckling Modes
panel_4 = Panel("10")  # disabled

# ---- group: Calculate Natural Vibrations
panel_5 = Panel("10")  # disabled
nvibes = NaturalVibrationsKaramba(FromIndex=1, NumberOfModes=panel_5, MaximumNumberOfIterations=30, Epsilon=1e-05)  # -> ModelWithVibrationModesAsLoadCaseResults, NaturalFrequencies_Hz, ModalMass_kg, ParticipationFactorInGlobalXYAndZDirection; disabled
panel_6 = Panel(nvibes.NaturalFrequencies_Hz)  # disabled

# ----
panel_7 = Panel("13")
item_2 = ListItem(Index=0, Wrap=True)

# ---- group: View Results
lc = Slider(0, range=0..9)  # disabled
modelview = ModelViewKaramba3D(LoadCaseFactorsForLinearSuperposition=1, IndexOfVisibleLoadcase=lc)  # -> Model, DeformedMesh, DeformedAxes, DeformedModel; disabled
beamview = BeamViewKaramba3D(Model=modelview.Model)  # -> Model, MeshesOfRenderedBeams, DeformedBeamAxes, LegendColors, LegendTags; disabled

lc_2 = Slider(0, range=0..9)  # disabled
modelview_2 = ModelViewKaramba3D(
    Model=nvibes.ModelWithVibrationModesAsLoadCaseResults,
    LoadCaseFactorsForLinearSuperposition=1,
    IndexOfVisibleLoadcase=lc_2)  # -> Model, DeformedMesh, DeformedAxes, DeformedModel; disabled
beamview_2 = BeamViewKaramba3D(Model=modelview_2.Model)  # -> Model, MeshesOfRenderedBeams, DeformedBeamAxes, LegendColors, LegendTags; disabled

# ----
panel_8 = Panel(item_2)
panel_9 = Panel("""1
2
3
4
5
6
7
8
9
10""")

# ----
# CROSS SECTIONS DEFINITIONS
# INDIVIDUAL SLATS
# (eccentricity on cross sections)
eccentricity_of_slats_cm = Panel("8")
height_of_1_slat_cm = Panel("1")
width_of_1_slat_cm = Panel("4")
Z_2 = UnitZ(Factor=expr("x/2", height_of_1_slat_cm))
Y = UnitY(Factor=eccentricity_of_slats_cm)
Z_3 = UnitZ(Factor=expr("x/2", height_of_1_slat_cm))
Y_2 = UnitY(Factor=eccentricity_of_slats_cm)
Z_4 = UnitZ(Factor=expr("x/2", height_of_1_slat_cm))
Y_3 = UnitY(Factor=eccentricity_of_slats_cm)
Z_5 = UnitZ(Factor=expr("x/2", height_of_1_slat_cm))
Y_4 = UnitY(Factor=eccentricity_of_slats_cm)
number_of_slats = Panel("2")
slat_number_z_ecce = Panel("top")
l_r_eccentricity = Panel("0")
slat_number_z_ecce_2 = Panel("bottom")
neg = Negative(Value=Z_3)
number_of_slats_2 = Panel("2")
slat_number_z_ecce_3 = Panel("top")
l_r_eccentricity_2 = Panel("1")
slat_number_z_ecce_4 = Panel("bottom")
Z_6 = UnitZ(Factor=height_of_1_slat_cm)
neg_2 = Negative(Value=Z_5)
addition_2 = Addition(A=Y, B=Z_2)
Y_5 = UnitY(Factor=eccentricity_of_slats_cm)
Z_7 = UnitZ(Factor=height_of_1_slat_cm)
Y_6 = UnitY(Factor=eccentricity_of_slats_cm)
Z_8 = UnitZ(Factor=height_of_1_slat_cm)
Y_7 = UnitY(Factor=eccentricity_of_slats_cm)
addition_3 = Addition(A=Y_2, B=neg)
Z_9 = UnitZ(Factor=height_of_1_slat_cm)
Y_8 = UnitY(Factor=eccentricity_of_slats_cm)
addition_4 = Addition(A=Y_3, B=Z_4)
number_of_slats_3 = Panel("3")
slat_number_z_ecce_5 = Panel("mid")
l_r_eccentricity_3 = Panel("0")
number_of_slats_4 = Panel("3")
slat_number_z_ecce_6 = Panel("mid")
l_r_eccentricity_4 = Panel("1")
slat_number_z_ecce_7 = Panel("top")
addition_5 = Addition(A=Y_4, B=neg_2)
slat_number_z_ecce_8 = Panel("top")
vec = Vector(addition_2)
slat_number_z_ecce_9 = Panel("bottom")
neg_3 = Negative(Value=Z_8)
slat_number_z_ecce_10 = Panel("bottom")
vec_2 = Vector(addition_3)
neg_4 = Negative(Value=Z_9)
Y_9 = UnitY(Factor=eccentricity_of_slats_cm)
Y_10 = UnitY(Factor=eccentricity_of_slats_cm)
vec_3 = Vector(addition_4)
neg_5 = Negative(Value=vec)
addition_6 = Addition(A=Y_5, B=Z_6)
vec_4 = Vector(addition_5)
neg_6 = Negative(Value=vec_2)
addition_7 = Addition(A=Y_6, B=Z_7)
addition_8 = Addition(A=Y_7, B=neg_3)
neg_7 = Negative(Value=vec_3)
addition_9 = Addition(A=Y_8, B=neg_4)
neg_8 = Negative(Value=vec_4)
vec_5 = Vector(Y_9)
vec_6 = Vector(Y_10)
concat = Concatenate(
    FragmentA="slats",
    FragmentB="-",
    FragmentC=number_of_slats,
    FragmentD="-",
    FragmentF=slat_number_z_ecce,
    FragmentG="-",
    FragmentE=l_r_eccentricity)
filter = StreamFilter(Gate=l_r_eccentricity, Stream0=vec, Stream1=neg_5)
vec_7 = Vector(addition_6)
vec_8 = Vector(addition_7)
filter_2 = StreamFilter(Gate=l_r_eccentricity, Stream0=vec_2, Stream1=neg_6)
concat_2 = Concatenate(
    FragmentA="slats",
    FragmentB="-",
    FragmentC=number_of_slats,
    FragmentD="-",
    FragmentF=slat_number_z_ecce_2,
    FragmentG="-",
    FragmentE=l_r_eccentricity)
neg_9 = Negative(Value=vec_5)
vec_9 = Vector(addition_8)
concat_3 = Concatenate(
    FragmentA="slats",
    FragmentB="-",
    FragmentC=number_of_slats_2,
    FragmentD="-",
    FragmentF=slat_number_z_ecce_3,
    FragmentG="-",
    FragmentE=l_r_eccentricity_2)
neg_10 = Negative(Value=vec_6)
filter_3 = StreamFilter(Gate=l_r_eccentricity_2, Stream0=vec_3, Stream1=neg_7)
vec_10 = Vector(addition_9)
neg_11 = Negative(Value=vec_7)
filter_4 = StreamFilter(Gate=l_r_eccentricity_2, Stream0=vec_4, Stream1=neg_8)
concat_4 = Concatenate(
    FragmentA="slats",
    FragmentB="-",
    FragmentC=number_of_slats_2,
    FragmentD="-",
    FragmentF=slat_number_z_ecce_4,
    FragmentG="-",
    FragmentE=l_r_eccentricity_2)
neg_12 = Negative(Value=vec_8)
data = Data(width_of_1_slat_cm)
neg_13 = Negative(Value=vec_9)
neg_14 = Negative(Value=vec_10)
data_2 = Data(width_of_1_slat_cm)
data_3 = Data(width_of_1_slat_cm)
concat_5 = Concatenate(
    FragmentA="slats",
    FragmentB="-",
    FragmentC=number_of_slats_3,
    FragmentD="-",
    FragmentF=slat_number_z_ecce_5,
    FragmentG="-",
    FragmentE=l_r_eccentricity_3)
filter_5 = StreamFilter(Gate=l_r_eccentricity_3, Stream0=vec_5, Stream1=neg_9)
concat_6 = Concatenate(
    FragmentA="slats",
    FragmentB="-",
    FragmentC=number_of_slats_4,
    FragmentD="-",
    FragmentF=slat_number_z_ecce_6,
    FragmentG="-",
    FragmentE=l_r_eccentricity_4)
filter_6 = StreamFilter(Gate=l_r_eccentricity_4, Stream0=vec_6, Stream1=neg_10)
filter_7 = StreamFilter(Gate=l_r_eccentricity_3, Stream0=vec_7, Stream1=neg_11)
concat_7 = Concatenate(
    FragmentA="slats",
    FragmentB="-",
    FragmentC=number_of_slats_3,
    FragmentD="-",
    FragmentF=slat_number_z_ecce_7,
    FragmentG="-",
    FragmentE=l_r_eccentricity_3)
data_4 = Data(width_of_1_slat_cm)
filter_8 = StreamFilter(Gate=l_r_eccentricity_4, Stream0=vec_8, Stream1=neg_12)
concat_8 = Concatenate(
    FragmentA="slats",
    FragmentB="-",
    FragmentC=number_of_slats_4,
    FragmentD="-",
    FragmentF=slat_number_z_ecce_8,
    FragmentG="-",
    FragmentE=l_r_eccentricity_4)
filter_9 = StreamFilter(Gate=l_r_eccentricity_3, Stream0=vec_9, Stream1=neg_13)
concat_9 = Concatenate(
    FragmentA="slats",
    FragmentB="-",
    FragmentC=number_of_slats_3,
    FragmentD="-",
    FragmentF=slat_number_z_ecce_9,
    FragmentG="-",
    FragmentE=l_r_eccentricity_3)
cross_section = CrossSectionKaramba3D(
    FamilyNameOfCrossSection="bamboo",
    NameOfCrossSection=concat,
    Color=ColourSwatch(SwatchColor=RGB(255, 255, 255)),
    Material=material,
    LocalEccentricity_cm=filter,
    Height_cm=height_of_1_slat_cm,
    UpperFlangeWidth_cm=data,
    LowerFlangeWidth_cm=data,
    mode="Trapezoid")
filter_10 = StreamFilter(Gate=l_r_eccentricity_4, Stream0=vec_10, Stream1=neg_14)
concat_10 = Concatenate(
    FragmentA="slats",
    FragmentB="-",
    FragmentC=number_of_slats_4,
    FragmentD="-",
    FragmentF=slat_number_z_ecce_10,
    FragmentG="-",
    FragmentE=l_r_eccentricity_4)
cross_section_2 = CrossSectionKaramba3D(
    FamilyNameOfCrossSection="bamboo",
    NameOfCrossSection=concat_2,
    Color=ColourSwatch(SwatchColor=RGB(255, 255, 255)),
    Material=material,
    LocalEccentricity_cm=filter_2,
    Height_cm=height_of_1_slat_cm,
    UpperFlangeWidth_cm=data_2,
    LowerFlangeWidth_cm=data_2,
    mode="Trapezoid")
data_5 = Data(width_of_1_slat_cm)
cross_section_3 = CrossSectionKaramba3D(
    FamilyNameOfCrossSection="bamboo",
    NameOfCrossSection=concat_3,
    Color=ColourSwatch(SwatchColor=RGB(255, 255, 255)),
    Material=material,
    LocalEccentricity_cm=filter_3,
    Height_cm=height_of_1_slat_cm,
    UpperFlangeWidth_cm=data_3,
    LowerFlangeWidth_cm=data_3,
    mode="Trapezoid")
data_6 = Data(width_of_1_slat_cm)
data_7 = Data(width_of_1_slat_cm)
cross_section_4 = CrossSectionKaramba3D(
    FamilyNameOfCrossSection="bamboo",
    NameOfCrossSection=concat_4,
    Color=ColourSwatch(SwatchColor=RGB(255, 255, 255)),
    Material=material,
    LocalEccentricity_cm=filter_4,
    Height_cm=height_of_1_slat_cm,
    UpperFlangeWidth_cm=data_4,
    LowerFlangeWidth_cm=data_4,
    mode="Trapezoid")
data_8 = Data(width_of_1_slat_cm)
data_9 = Data(width_of_1_slat_cm)
data_10 = Data(width_of_1_slat_cm)
cross_section_5 = CrossSectionKaramba3D(
    FamilyNameOfCrossSection="bamboo",
    NameOfCrossSection=concat_5,
    Color=ColourSwatch(SwatchColor=RGB(255, 255, 255)),
    Material=material,
    LocalEccentricity_cm=filter_5,
    Height_cm=height_of_1_slat_cm,
    UpperFlangeWidth_cm=data_5,
    LowerFlangeWidth_cm=data_5,
    mode="Trapezoid")
cross_section_6 = CrossSectionKaramba3D(
    FamilyNameOfCrossSection="bamboo",
    NameOfCrossSection=concat_6,
    Color=ColourSwatch(SwatchColor=RGB(255, 255, 255)),
    Material=material,
    LocalEccentricity_cm=filter_6,
    Height_cm=height_of_1_slat_cm,
    UpperFlangeWidth_cm=data_6,
    LowerFlangeWidth_cm=data_6,
    mode="Trapezoid")
cross_section_7 = CrossSectionKaramba3D(
    FamilyNameOfCrossSection="bamboo",
    NameOfCrossSection=concat_7,
    Color=ColourSwatch(SwatchColor=RGB(255, 255, 255)),
    Material=material,
    LocalEccentricity_cm=filter_7,
    Height_cm=height_of_1_slat_cm,
    UpperFlangeWidth_cm=data_7,
    LowerFlangeWidth_cm=data_7,
    mode="Trapezoid")
cross_section_8 = CrossSectionKaramba3D(
    FamilyNameOfCrossSection="bamboo",
    NameOfCrossSection=concat_8,
    Color=ColourSwatch(SwatchColor=RGB(255, 255, 255)),
    Material=material,
    LocalEccentricity_cm=filter_8,
    Height_cm=height_of_1_slat_cm,
    UpperFlangeWidth_cm=data_8,
    LowerFlangeWidth_cm=data_8,
    mode="Trapezoid")
cross_section_9 = CrossSectionKaramba3D(
    FamilyNameOfCrossSection="bamboo",
    NameOfCrossSection=concat_9,
    Color=ColourSwatch(SwatchColor=RGB(255, 255, 255)),
    Material=material,
    LocalEccentricity_cm=filter_9,
    Height_cm=height_of_1_slat_cm,
    UpperFlangeWidth_cm=data_9,
    LowerFlangeWidth_cm=data_9,
    mode="Trapezoid")
cross_section_10 = CrossSectionKaramba3D(
    FamilyNameOfCrossSection="bamboo",
    NameOfCrossSection=concat_10,
    Color=ColourSwatch(SwatchColor=RGB(255, 255, 255)),
    Material=material,
    LocalEccentricity_cm=filter_10,
    Height_cm=height_of_1_slat_cm,
    UpperFlangeWidth_cm=data_10,
    LowerFlangeWidth_cm=data_10,
    mode="Trapezoid")
entwine_3 = Entwine(Branch00=cross_section, Branch01=cross_section_2, FlattenInputs=True)  # -> simplify(Result)
entwine_4 = Entwine(Branch00=cross_section_3, Branch01=cross_section_4, FlattenInputs=True)  # -> simplify(Result)
entwine_5 = Entwine(Branch00=cross_section_5, Branch01=cross_section_7, Branch02=cross_section_9, FlattenInputs=True)  # -> simplify(Result)
entwine_6 = Entwine(Branch00=cross_section_6, Branch01=cross_section_8, Branch02=cross_section_10, FlattenInputs=True)  # -> simplify(Result)
entwine_7 = Entwine(Branch0X=entwine_3, Branch1X=entwine_4, FlattenInputs=False)  # -> simplify(Result)
entwine_8 = Entwine(Branch0X=entwine_5, Branch1X=entwine_6, FlattenInputs=False)  # -> simplify(Result)

# ---- group: Bamboo full culm
diameter_of_bamboo_cm = Panel("12")
bamboo_wall_thickness_cm = Panel("1")
cross_section_11 = CrossSectionKaramba3D(
    FamilyNameOfCrossSection="bamboo",
    NameOfCrossSection="diam-12",
    Material=material,
    Diameter_cm=diameter_of_bamboo_cm,
    WallThickness_cm=bamboo_wall_thickness_cm,
    mode="Circular Hollow")

# ----
# BEAMS DEFINITION
crosec = CrossSectionKaramba3D(cross_section_11)

# ----
# Upper & lower chord beams
panel_10 = Panel("Chord-upper")
data_11 = Data(flatten(line_9))
data_12 = Data(flatten(line_10))
linetobeam = LineToBeamKaramba3D(Line=data_11, Identifier=panel_10, CrossSection=crosec, New=True, Remove=True, LimitDistance_m=0.005)  # -> Element, Points, Info
linetobeam_2 = LineToBeamKaramba3D(Line=data_12, Identifier="Chord-lower", CrossSection=crosec, New=True, Remove=True, LimitDistance_m=0.005)  # -> Element, Points, Info

# ----
# CROSS SECTIONS DEFINITIONS
# (eccentricity on cross sections)
eccentricity_of_slats_cm_2 = Panel("8")
height_of_1_slat_cm_2 = Panel("1")
width_of_1_slat_cm_2 = Panel("4")
number_of_slats_5 = Panel("2")
number_of_slats_6 = Panel("2")
eccentricity = Panel("0")
eccentricity_2 = Panel("1")
number_of_slats_7 = Panel("3")
number_of_slats_8 = Panel("3")
eccentricity_3 = Panel("0")
eccentricity_4 = Panel("1")
Z_10 = UnitZ(Factor=eccentricity_of_slats_cm_2)
Y_11 = UnitY(Factor=eccentricity_of_slats_cm_2)
X_2 = UnitX(Factor=eccentricity_of_slats_cm_2)
Z_11 = UnitZ(Factor=eccentricity_of_slats_cm_2)
Y_12 = UnitY(Factor=eccentricity_of_slats_cm_2)
X_3 = UnitX(Factor=eccentricity_of_slats_cm_2)
Z_12 = UnitZ(Factor=eccentricity_of_slats_cm_2)
Y_13 = UnitY(Factor=eccentricity_of_slats_cm_2)
X_4 = UnitX(Factor=eccentricity_of_slats_cm_2)
Z_13 = UnitZ(Factor=eccentricity_of_slats_cm_2)
Y_14 = UnitY(Factor=eccentricity_of_slats_cm_2)
X_5 = UnitX(Factor=eccentricity_of_slats_cm_2)
vec_11 = Vector(Y_11)
vec_12 = Vector(Y_12)
vec_13 = Vector(Y_13)
vec_14 = Vector(Y_14)
neg_15 = Negative(Value=vec_11)
neg_16 = Negative(Value=vec_12)
neg_17 = Negative(Value=vec_13)
neg_18 = Negative(Value=vec_14)
swatch_2 = ColourSwatch(SwatchColor=RGB(255, 255, 255))
filter_11 = StreamFilter(Gate=eccentricity, Stream0=vec_11, Stream1=neg_15)
concat_11 = Concatenate(FragmentA="slats", FragmentB="-", FragmentC=number_of_slats_5, FragmentD="-", FragmentE=eccentricity)
filter_12 = StreamFilter(Gate=eccentricity_2, Stream0=vec_12, Stream1=neg_16)
multiplication_24 = Multiplication(A=number_of_slats_5, B=height_of_1_slat_cm_2)
concat_12 = Concatenate(FragmentA="slats", FragmentB="-", FragmentC=number_of_slats_6, FragmentD="-", FragmentE=eccentricity_2)
multiplication_25 = Multiplication(A=number_of_slats_6, B=height_of_1_slat_cm_2)
swatch_3 = ColourSwatch(SwatchColor=RGB(157, 214, 139))
data_13 = Data(width_of_1_slat_cm_2)
filter_13 = StreamFilter(Gate=eccentricity_3, Stream0=vec_13, Stream1=neg_17)
data_14 = Data(width_of_1_slat_cm_2)
concat_13 = Concatenate(FragmentA="slats", FragmentB="-", FragmentC=number_of_slats_7, FragmentD="-", FragmentE=eccentricity_3)
filter_14 = StreamFilter(Gate=eccentricity_4, Stream0=vec_14, Stream1=neg_18)
multiplication_26 = Multiplication(A=number_of_slats_7, B=height_of_1_slat_cm_2)
concat_14 = Concatenate(FragmentA="slats", FragmentB="-", FragmentC=number_of_slats_8, FragmentD="-", FragmentE=eccentricity_4)
multiplication_27 = Multiplication(A=number_of_slats_8, B=height_of_1_slat_cm_2)
data_15 = Data(width_of_1_slat_cm_2)
data_16 = Data(width_of_1_slat_cm_2)
cross_section_12 = CrossSectionKaramba3D(
    FamilyNameOfCrossSection="bamboo",
    NameOfCrossSection=concat_11,
    Color=swatch_2,
    Material=material,
    LocalEccentricity_cm=filter_11,
    Height_cm=multiplication_24,
    UpperFlangeWidth_cm=data_13,
    LowerFlangeWidth_cm=data_13,
    mode="Trapezoid")
cross_section_13 = CrossSectionKaramba3D(
    FamilyNameOfCrossSection="bamboo",
    NameOfCrossSection=concat_12,
    Color=swatch_2,
    Material=material,
    LocalEccentricity_cm=filter_12,
    Height_cm=multiplication_25,
    UpperFlangeWidth_cm=data_14,
    LowerFlangeWidth_cm=data_14,
    mode="Trapezoid")
cross_section_14 = CrossSectionKaramba3D(
    FamilyNameOfCrossSection="bamboo",
    NameOfCrossSection=concat_13,
    Color=swatch_3,
    Material=material,
    LocalEccentricity_cm=filter_13,
    Height_cm=multiplication_26,
    UpperFlangeWidth_cm=data_15,
    LowerFlangeWidth_cm=data_15,
    mode="Trapezoid")
cross_section_15 = CrossSectionKaramba3D(
    FamilyNameOfCrossSection="bamboo",
    NameOfCrossSection=concat_14,
    Color=swatch_3,
    Material=material,
    LocalEccentricity_cm=filter_14,
    Height_cm=multiplication_27,
    UpperFlangeWidth_cm=data_16,
    LowerFlangeWidth_cm=data_16,
    mode="Trapezoid")
entwine_9 = Entwine(Branch00=cross_section_12, Branch01=cross_section_13, FlattenInputs=True)  # -> simplify(Result)
entwine_10 = Entwine(Branch00=cross_section_14, Branch01=cross_section_15, FlattenInputs=True)  # -> simplify(Result)

# ---- group: Bamboo full culm
diameter_of_bamboo_cm_2 = Panel("12")
bamboo_wall_thickness_cm_2 = Panel("1")
cross_section_16 = CrossSectionKaramba3D(
    FamilyNameOfCrossSection="bamboo",
    NameOfCrossSection="diam-12",
    Material=material,
    Diameter_cm=diameter_of_bamboo_cm_2,
    WallThickness_cm=bamboo_wall_thickness_cm_2,
    mode="Circular Hollow")

# ----
panel_11 = Panel(cross_section_11)
crosec_2 = CrossSectionKaramba3D([cross_section_11, cross_section, cross_section_2, cross_section_3, cross_section_4, cross_section_5, cross_section_7, cross_section_9, cross_section_6, cross_section_8, cross_section_10])
filter_15 = StreamFilter(Gate=number_slider, Stream0=entwine_10, Stream1=entwine_8)
filter_16 = StreamFilter(Gate=number_slider, Stream0=entwine_9, Stream1=entwine_7)
crosec_3 = CrossSectionKaramba3D(filter_16)
crosec_4 = CrossSectionKaramba3D(filter_15)

# ---- group: Bamboo full culm
diameter_of_bamboo_cm_3 = Panel("12")
bamboo_wall_thickness_cm_3 = Panel("1")
cross_section_17 = CrossSectionKaramba3D(
    FamilyNameOfCrossSection="bamboo",
    NameOfCrossSection="diam-12",
    Material=material,
    Diameter_cm=diameter_of_bamboo_cm_3,
    WallThickness_cm=bamboo_wall_thickness_cm_3,
    mode="Circular Hollow")

# ----
# CROSS SECTIONS DEFINITIONS
# (eccentricity on beam elements)
number_of_slats_9 = Panel("""2
3""")
data_17 = Data(graft(number_of_slats_9))
concat_15 = Concatenate(FragmentA="slats", FragmentB="-", FragmentC=data_17)
multiplication_28 = Multiplication(A=data_17, B=height_of_1_slat_cm_2)
data_18 = Data(width_of_1_slat_cm_2)
cross_section_18 = CrossSectionKaramba3D(
    FamilyNameOfCrossSection="bamboo",
    NameOfCrossSection=concat_15,
    Color=ColourSwatch(SwatchColor=RGB(157, 214, 139)),
    Material=material,
    Height_cm=multiplication_28,
    UpperFlangeWidth_cm=data_18,
    LowerFlangeWidth_cm=data_18,
    mode="Trapezoid")
panel_12 = Panel(cross_section_17)
bang_3 = ExplodeTree(Data=cross_section_18)  # -> Branch0, Branch1
crosec_5 = CrossSectionKaramba3D([cross_section_17, cross_section_18])

panel_13 = Panel(cross_section_16)
crosec_6 = CrossSectionKaramba3D([cross_section_16, cross_section_12, cross_section_13, cross_section_14, cross_section_15])

crosec_7 = CrossSectionKaramba3D(crosec_2)

# ----
# Slat web elts
panel_14 = Panel("web-diag-mid")
crosec_8 = CrossSectionKaramba3D(crosec_3)
line_11 = Line(flatten(line_8))
line_12 = Line(flatten(line_7))
line_13 = Line(flatten(line_6))
crosec_9 = CrossSectionKaramba3D(crosec_4)
crosec_10 = CrossSectionKaramba3D(crosec_8)
linetobeam_3 = LineToBeamKaramba3D(Line=line_11, Identifier="web-diag-end", CrossSection=crosec_9, New=True, Remove=True, LimitDistance_m=0.005)  # -> Element, Points, Info
linetobeam_4 = LineToBeamKaramba3D(Line=line_12, Identifier=panel_14, CrossSection=crosec_10, New=True, Remove=True, LimitDistance_m=0.005)  # -> Element, Points, Info
linetobeam_5 = LineToBeamKaramba3D(Line=line_13, Identifier="web-vert", CrossSection=crosec_8, New=True, Remove=True, LimitDistance_m=0.005)  # -> Element, Points, Info

# ----
# BEAMS DEFINITION
panel_15 = Panel("web-diag-end")
line_14 = Line(flatten(line_8))
toggle = BooleanToggle(True)
line_15 = Line(flatten(line_7))
line_16 = Line(flatten(line_6))
crosec_11 = CrossSectionKaramba3D(bang_3.Branch1)
crosec_12 = CrossSectionKaramba3D(bang_3.Branch0)
crosec_13 = CrossSectionKaramba3D(bang_3.Branch0)
toggle_2 = BooleanToggle(True)
linetobeam_6 = LineToBeamKaramba3D(Line=line_14, Identifier=panel_15, CrossSection=crosec_11, New=True, Remove=True, LimitDistance_m=0.005)  # -> Element, Points, Info
linetobeam_7 = LineToBeamKaramba3D(Line=line_15, Identifier="web-diag-mid", CrossSection=crosec_12, New=True, Remove=True, LimitDistance_m=0.005)  # -> Element, Points, Info
toggle_3 = BooleanToggle(True)
linetobeam_8 = LineToBeamKaramba3D(Line=line_16, Identifier="web-vert", CrossSection=crosec_13, New=True, Remove=True, LimitDistance_m=0.005)  # -> Element, Points, Info
Y_15 = UnitY(Factor=eccentricity_of_slats_cm_2)
Y_16 = UnitY(Factor=eccentricity_of_slats_cm_2)
Y_17 = UnitY(Factor=eccentricity_of_slats_cm_2)
concat_16 = Concatenate(FragmentA=panel_15, FragmentB="-", FragmentC="L")
concat_17 = Concatenate(FragmentA=panel_15, FragmentB="-", FragmentC="R")
concat_18 = Concatenate(FragmentA="web-diag-mid", FragmentB="-", FragmentC="L")
concat_19 = Concatenate(FragmentA="web-diag-mid", FragmentB="-", FragmentC="R")
neg_19 = Negative(Value=Y_15)
neg_20 = Negative(Value=Y_16)
concat_20 = Concatenate(FragmentA="web-vert", FragmentB="-", FragmentC="L")
concat_21 = Concatenate(FragmentA="web-vert", FragmentB="-", FragmentC="R")
neg_21 = Negative(Value=Y_17)
modifyelem = ModifyElementKaramba3D(Beam=linetobeam_6.Element, BeamIdentifierIndex=concat_16, Bending=toggle, LocalEccentricity_cm=Y_15, mode="Beam")
modifyelem_2 = ModifyElementKaramba3D(Beam=linetobeam_6.Element, BeamIdentifierIndex=concat_17, Bending=toggle, LocalEccentricity_cm=neg_19, mode="Beam")
modifyelem_3 = ModifyElementKaramba3D(Beam=linetobeam_7.Element, BeamIdentifierIndex=concat_18, Bending=toggle_3, LocalEccentricity_cm=Y_16, mode="Beam")
modifyelem_4 = ModifyElementKaramba3D(Beam=linetobeam_7.Element, BeamIdentifierIndex=concat_19, Bending=toggle_3, LocalEccentricity_cm=neg_20, mode="Beam")
modifyelem_5 = ModifyElementKaramba3D(Beam=linetobeam_8.Element, BeamIdentifierIndex=concat_20, Bending=toggle_2, LocalEccentricity_cm=Y_17, mode="Beam")
modifyelem_6 = ModifyElementKaramba3D(Beam=linetobeam_8.Element, BeamIdentifierIndex=concat_21, Bending=toggle_2, LocalEccentricity_cm=neg_21, mode="Beam")

entwine_11 = Entwine(
    Branch00=linetobeam.Element,
    Branch01=linetobeam_2.Element,
    Branch02=linetobeam_3.Element,
    Branch03=linetobeam_4.Element,
    Branch04=linetobeam_5.Element,
    Branch05=linetobeam_5.Element,
    FlattenInputs=True)  # -> flatten(Result)

# ----
# Hinges on the slat elts,
# at connection to either upper or lower chord
entwine_12 = Entwine(Branch00="Chord-lower", Branch01=panel_10, FlattenInputs=True)  # -> flatten(Result)
# JOINTS DEFINITION
entwine_13 = Entwine(Branch00="web-vert", Branch01=panel_14, Branch02="web-diag-end", FlattenInputs=True)  # -> flatten(Result)
joint_2 = JointKaramba3D()

# ----
# JOINTS DEFINITION
# Hinges on the slat elts,
# at connection to either upper or lower chord
entwine_14 = Entwine(
    Branch00=concat_16,
    Branch01=concat_17,
    Branch02=concat_18,
    Branch03=concat_19,
    Branch04=concat_20,
    Branch05=concat_21,
    FlattenInputs=True)  # -> flatten(Result)
entwine_15 = Entwine(Branch00="Chord-lower", Branch01=panel_10, FlattenInputs=True)  # -> flatten(Result)

crosec_14 = CrossSectionKaramba3D(flatten(crosec_7))
joint_3 = JointKaramba3D(flatten(joint_2))
element = ElementKaramba3D(flatten(entwine_11))
entwine_16 = Entwine(
    Branch00=linetobeam.Element,
    Branch01=linetobeam_2.Element,
    Branch02=modifyelem,
    Branch03=modifyelem_2,
    Branch04=modifyelem_3,
    Branch05=modifyelem_4,
    Branch06=modifyelem_5,
    Branch07=modifyelem_6,
    FlattenInputs=True)  # -> flatten(Result)
crosec_15 = CrossSectionKaramba3D(flatten(crosec_5))
element_2 = ElementKaramba3D(flatten(entwine_16))

# ----
# Load case detail: G = Dead load (Gravity)
# G + 1 kN
# G + 2 kN
# G + 3 kN
# G + 4 kN
# G + 5 kN
# G + 6 kN
# G + 7 kN
# G + 8 kN
# G + 9 kN
# G + 10 kN
# G + 11 kN
# G + 12 kN
# G + 7.063 kN - Villegas
# Punctual loading
load_case_13_kn_service_from_villegas_11 = Panel("7.063")  # "Load Case 13 (kN) - service from Villegas (11.4mm deflection expected)"
series_2 = Series(Start="1", Step=1, Count="12")
entwine_17 = Entwine(Branch00=series_2, Branch01=load_case_13_kn_service_from_villegas_11, FlattenInputs=True)  # -> flatten(Result)
series_3 = Series(Start="1", Step=1, Count="13")  # -> simplify(graft(Series))
pt_4 = Point(dispatch_3.ListB)
load = LoadKaramba3D()

# ----
# LOADS DEFINITION
num = Number(graft(entwine_17))

division_2 = Division(A=num, B="3")
neg_22 = Negative(Value=division_2)
Z_14 = UnitZ(Factor=neg_22)  # -> simplify(UnitVector)

load_2 = LoadKaramba3D(flatten(load))
assemble = AssembleModelKaramba3D(Elem=element, Support=support_2, Load=load_2, Joint=joint_3, LimitDistance_m=0.005)  # -> Model, Info, Mass_kg, CenterOfGravity
analyze = AnalyzeKaramba3D(Model=assemble.Model)  # -> CalculatedModel, MaximumDisplacement_cm, ResultingForceOfGravity_kN, ElasticEnergy_kNm
disassemble = DisassembleModelKaramba3D(Model=assemble.Model)  # -> Model, Point, Beam, Shell, Support, Load, Line, Mesh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
load_3 = LoadKaramba3D(flatten(load))
max_displacement_cm = Panel(analyze.MaximumDisplacement_cm)
select = SelectElementKaramba3D(Elements=disassemble.Beam, ElementIdentifiers="web-diag-end")  # -> SelectedElements, RejectedElements
assemble_2 = AssembleModelKaramba3D(Elem=element_2, Support=support_3, Load=load_3, Joint=joint, LimitDistance_m=0.005)  # -> Model, Info, Mass_kg, CenterOfGravity
disassemble_2 = DisassembleElementKaramba3D(Element=select.SelectedElements)  # -> Element, ElementIdentifier, AxisOfElement, CrossSection, Joints, Material, LocalCoordinateSystem, ElementIsActive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
analyze_2 = AnalyzeKaramba3D(Model=assemble_2.Model)  # -> CalculatedModel, MaximumDisplacement_cm, ResultingForceOfGravity_kN, ElasticEnergy_kNm

# ----
# RESULTS
# (eccentricities on the cross sections)
modelview_3 = ModelViewKaramba3D(Model=analyze.CalculatedModel, ResultFactors=1, ResultCase=-1)  # -> Model, DeformedMesh, DeformedAxes, DeformedModel
beamview_3 = BeamViewKaramba3D(Model=modelview_3.Model)  # -> Model, MeshesOfRenderedBeams, DeformedBeamAxes, LegendColors, LegendTags
rec = Rectangle({Plane=PlaneXY(6.531513667, -4.567201621, 0), Size=Domain2(u=-2.703667867..2.703667867, v=-3.575245008..3.575245008)})
panel_16 = Panel("1 kN/cm2 = 10 MPa")
legend = Legend(Colour=beamview_3.LegendColors, Tags=beamview_3.LegendTags, LegendType=1)
panel_17 = Panel(beamview_3.LegendTags)
first_last_elt_4 = FirstLastElt(L=beamview_3.LegendTags)
dispatch_4 = Dispatch(List=beamview_3.LegendTags, DispatchPattern=first_last_elt_4)  # -> ListA, ListB
item_3 = ListItem(List=dispatch_4.ListB, Index=0, Wrap=True)
num_2 = Number(item_3)

emodes = EigenModesKaramba3D(Model=analyze_2.CalculatedModel, FromIndex=1, NumberOfModes=1, MaximumNumberOfIterations=300, Epsilon=1e-07)  # -> ModelWithEigenModesAsLoadCaseResults, Eigenvalues
# RESULTS
# (eccentricities on the beam elements)
max_displacement_cm_2 = Panel(analyze_2.MaximumDisplacement_cm)
b_forces = BeamForcesKaramba3D(
    AnalyzedModel=analyze.CalculatedModel,
    BeamIdentifiers="web-vert",
    LCase="13",
    MaximumDistanceBetweenResults_m=-1,
    NumberOfResultsPerBeamElement="1")  # -> AnalyzedModel, NormalForce_kN, ShearForceVz_kN, ShearForceVy_kN, BendingMomentMt_kNm, BendingMomentMy_kNm, BendingMomentMz_kNm

modelview_4 = ModelViewKaramba3D(Model=analyze_2.CalculatedModel, ResultFactors=1, ResultCase=-1)  # -> Model, DeformedMesh, DeformedAxes, DeformedModel
beamview_4 = BeamViewKaramba3D(Model=modelview_4.Model)  # -> Model, MeshesOfRenderedBeams, DeformedBeamAxes, LegendColors, LegendTags
rec_2 = Rectangle({Plane=PlaneXY(6.531513667, -4.567201621, 0), Size=Domain2(u=-2.703667867..2.703667867, v=-3.575245008..3.575245008)})
legend_2 = Legend(Colour=beamview_4.LegendColors, Tags=beamview_4.LegendTags, LegendType=1)
panel_19 = Panel(beamview_4.LegendTags)
first_last_elt_5 = FirstLastElt(L=beamview_4.LegendTags)
dispatch_5 = Dispatch(List=beamview_4.LegendTags, DispatchPattern=first_last_elt_5)  # -> ListA, ListB
item_4 = ListItem(List=dispatch_5.ListB, Index=0, Wrap=True)
num_3 = Number(item_4)

item_5 = ListItem(List=b_forces.NormalForce_kN, Index=0, Wrap=True)
panel_20 = Panel(b_forces.AnalyzedModel)

# ----
# Villegas against this model plot (Rhino)
panel_21 = Panel("1")
split_5 = SplitList(List=max_displacement_cm, Index=panel_21)  # -> ListA, ListB
rev = ReverseList(List=split_5.ListB)
split_6 = SplitList(List=rev, Index=panel_21)  # -> ListA, ListB
y_grid_spacing = Panel("1")
x_grid_spacing = Panel("1")
rev_2 = ReverseList(List=split_6.ListB)
num_4 = Number(rev_2)
sort_2 = SortList(Keys=series_2)  # -> Keys, ValuesA
rev_3 = ReverseList(List=sort_2.Keys)
item_6 = ListItem(List=rev_3, Index=0, Wrap=True)
round = Round(Number=item_6)  # -> Nearest, Floor, Ceiling
addition_10 = Addition(A=round.Ceiling, B="1")
experimental_load_increment_n_villegas = Panel("970.2")
experimenntal_deflection_at_9_702kn = Panel("17.2")
division_3 = Division(A=round.Ceiling, B=y_grid_spacing)
series_4 = Series(Start=0, Step=y_grid_spacing, Count=expr("x+2", division_3))
Y_18 = UnitY(Factor=addition_10)
division_4 = Division(A=experimental_load_increment_n_villegas, B="1000")
pt_5 = ConstructPoint(XCoordinate=0, YCoordinate=series_4, ZCoordinate=0)
range = Range(Domain=experimenntal_deflection_at_9_702kn, Steps="10")
series_5 = Series(Start=0, Step=division_4, Count="11")
pt_6 = ConstructPoint(XCoordinate=range, YCoordinate=series_5, ZCoordinate=0)
pline = PolyLine(Vertices=pt_6, Closed=False)
x_axis_factor = Panel("1")
y_axis_factor = Panel("1")
X_6 = UnitX(Factor="0.5")
X_7 = UnitX(Factor="0.5")
Y_19 = UnitY(Factor="-1")
number_slider_2 = Slider(2, range=0..10)
Y_20 = UnitY(Factor="-0.5")
X_8 = UnitX(Factor="-0.5")
swatch_4 = ColourSwatch(SwatchColor=RGB(107, 107, 107))
swatch_5 = ColourSwatch(SwatchColor=RGB(107, 107, 107))
addition_11 = Addition(A=X_7, B=Y_19)
swatch_6 = ColourSwatch(SwatchColor=RGB(164, 199, 68))
swatch_7 = ColourSwatch(SwatchColor=RGB(148, 90, 72))
multiplication_29 = Multiplication(A=split_6.ListA, B="10")
Y_21 = UnitY(Factor="1.5")
swatch_8 = ColourSwatch(SwatchColor=RGB(83, 109, 194))
concat_22 = Concatenate(FragmentA="this model: ", FragmentC=multiplication_29, FragmentB="mm")

# ---- group: X (deflection, mm)
multiplication_30 = Multiplication(A=num_4, B="10")

# ----
sort_3 = SortList(Keys=multiplication_30)  # -> Keys, ValuesA
rev_4 = ReverseList(List=sort_3.Keys)
pt_7 = ConstructPoint(XCoordinate=multiplication_30, YCoordinate=series_2, ZCoordinate=0)
item_7 = ListItem(List=rev_4, Index=0, Wrap=True)
round_2 = Round(Number=item_7)  # -> Nearest, Floor, Ceiling
pline_2 = PolyLine(Vertices=pt_7, Closed=False)
max = Maximum(A=round_2.Ceiling, B=experimenntal_deflection_at_9_702kn)
division_5 = Division(A=round_2.Ceiling, B=x_grid_spacing)
addition_12 = Addition(A=max, B="1")
rectangle = Rectangle(Plane=PlaneXY(0, 0, 0), XSize=addition_12, YSize=addition_10, Radius=0)  # -> Rectangle, Length
series_6 = Series(Start=0, Step=x_grid_spacing, Count=expr("x+2", division_5))
pt_8 = ConstructPoint(XCoordinate=series_6, YCoordinate=0, ZCoordinate=0)
X_9 = UnitX(Factor=addition_12)
move_3 = Move(Geometry=pt_8, Motion=Y_18)  # -> Geometry, Transform
move_4 = Move(Geometry=pt_5, Motion=X_9)  # -> Geometry, Transform
ln_5 = Line(StartPoint=pt_8, EndPoint=move_3.Geometry)
ln_6 = Line(StartPoint=pt_5, EndPoint=move_4.Geometry)
entwine_18 = Entwine(
    Branch00=pline_2,
    Branch01=pt_7,
    Branch02=pline,
    Branch03=pt_6,
    Branch04=pt_5,
    Branch05=ln_6,
    Branch06=pt_8,
    Branch07=ln_5,
    Branch08=rectangle.Rectangle,
    FlattenInputs=True)
scale_nu = ScaleNU(Geometry=entwine_18, Plane=PlaneXY(0, 0, 0), ScaleX=x_axis_factor, ScaleY=y_axis_factor, ScaleZ=1)  # -> Geometry, Transform
bang_4 = ExplodeTree(Data=scale_nu.Geometry)  # -> Branch0, Branch1, Branch2, Branch3, Branch4, Branch5, Branch6, Branch7, Branch8
drec = DeconstuctRectangle(Rectangle=bang_4.Branch8)  # -> BasePlane, XInterval, YInterval
drec_2 = DeconstuctRectangle(Rectangle=bang_4.Branch8)  # -> BasePlane, XInterval, YInterval
pt_9 = ConstructPoint(XCoordinate=drec.XInterval, YCoordinate=drec.YInterval, ZCoordinate=0)
pt_10 = ConstructPoint(XCoordinate=drec_2.XInterval, YCoordinate=drec_2.YInterval, ZCoordinate=0)
move_5 = Move(Geometry=pt_9, Motion=X_6)  # -> Geometry, Transform
move_6 = Move(Geometry=bang_4.Branch4, Motion=X_8)  # -> Geometry, Transform
item_8 = ListItem(List=move_6.Geometry, Index="6", Wrap=True)
move_7 = Move(Geometry=item_8, Motion=X_8)  # -> Geometry, Transform
move_8 = Move(Geometry=bang_4.Branch6, Motion=Y_20)  # -> Geometry, Transform
lng_2 = ListLength(List=move_8.Geometry)  # -> expr("x/2", Length)
item_9 = ListItem(List=move_8.Geometry, Index=lng_2, Wrap=True)
move_9 = Move(Geometry=item_9, Motion=Y_20)  # -> Geometry, Transform
move_10 = Move(Geometry=pt_10, Motion=addition_11)  # -> Geometry, Transform
pt_11 = ConstructPoint(XCoordinate=expr("x/2", drec_2.XInterval), YCoordinate=drec_2.YInterval, ZCoordinate=0)
move_11 = Move(Geometry=pt_11, Motion=Y_21)  # -> Geometry, Transform
move_12 = Move(Geometry=move_11.Geometry, Motion=Y_21)  # -> Geometry, Transform
move_13 = Move(Geometry=move_12.Geometry, Motion=Y_21)  # -> Geometry, Transform

preview = CustomPreview(Geometry=[bang_4.Branch0, bang_4.Branch1], Material=swatch_7)
preview_2 = CustomPreview(Geometry=[bang_4.Branch2, bang_4.Branch3], Material=swatch_6)
preview_3 = CustomPreview(Geometry=bang_4.Branch5, Material=swatch_4)
preview_4 = CustomPreview(Geometry=bang_4.Branch7, Material=swatch_5)
preview_5 = CustomPreview(Geometry=bang_4.Branch8, Material=ColourSwatch(SwatchColor=RGB(0, 0, 0)))
tag = TextTag3D(Location=move_5.Geometry, Text="Numerical model curve", Size="1", Colour=swatch_7, Justification="1")
tag_2 = TextTag3D(Location=move_10.Geometry, Text="Villegas model curve", Size="1", Colour=swatch_6, Justification="1")
tag_3 = TextTag3D(Location=move_13.Geometry, Text="At 7.063kN service load", Size=1, Colour=swatch_8, Justification="5")
tag_4 = TextTag3D(Location=move_12.Geometry, Text="Villegas: 11.4mm", Size=1, Colour=swatch_8, Justification="5")
tag_5 = TextTag3D(Location=move_11.Geometry, Text=concat_22, Size=1, Colour=swatch_8, Justification="5")
tag_6 = TextTag3D(Location=move_6.Geometry, Text=series_4, Size="0.3", Colour=swatch_4, Justification=Slider(4, range=0..10))
tag_7 = TextTag3D(Location=move_7.Geometry, Text="Load (kN)", Size="0.6", Colour=swatch_4, Justification=Slider(3, range=0..10))
tag_8 = TextTag3D(Location=move_8.Geometry, Text=series_6, Size="0.3", Colour=swatch_5, Justification=number_slider_2)
tag_9 = TextTag3D(Location=move_9.Geometry, Text="max displacement (cm)", Size="0.6", Colour=swatch_5, Justification=number_slider_2)

# ----
# Villegas against this model plot (Rhino)
panel_22 = Panel("1")
split_7 = SplitList(List=analyze_2.MaximumDisplacement_cm, Index=panel_22)  # -> ListA, ListB
rev_5 = ReverseList(List=split_7.ListB)
split_8 = SplitList(List=rev_5, Index=panel_22)  # -> ListA, ListB
y_grid_spacing_2 = Panel("1")
x_grid_spacing_2 = Panel("1")
rev_6 = ReverseList(List=split_8.ListB)
num_5 = Number(rev_6)
sort_4 = SortList(Keys=series_2)  # -> Keys, ValuesA
rev_7 = ReverseList(List=sort_4.Keys)
item_10 = ListItem(List=rev_7, Index=0, Wrap=True)
round_3 = Round(Number=item_10)  # -> Nearest, Floor, Ceiling
addition_13 = Addition(A=round_3.Ceiling, B="1")
experimental_load_increment_n_villegas_2 = Panel("970.2")
experimenntal_deflection_at_9_702kn_2 = Panel("17.2")
division_6 = Division(A=round_3.Ceiling, B=y_grid_spacing_2)
series_7 = Series(Start=0, Step=y_grid_spacing_2, Count=expr("x+2", division_6))
Y_22 = UnitY(Factor=addition_13)
division_7 = Division(A=experimental_load_increment_n_villegas_2, B="1000")
pt_12 = ConstructPoint(XCoordinate=0, YCoordinate=series_7, ZCoordinate=0)
range_2 = Range(Domain=experimenntal_deflection_at_9_702kn_2, Steps="10")
series_8 = Series(Start=0, Step=division_7, Count="11")
pt_13 = ConstructPoint(XCoordinate=range_2, YCoordinate=series_8, ZCoordinate=0)
pline_3 = PolyLine(Vertices=pt_13, Closed=False)
x_axis_factor_2 = Panel("1")
y_axis_factor_2 = Panel("1")
X_10 = UnitX(Factor="0.5")
X_11 = UnitX(Factor="0.5")
Y_23 = UnitY(Factor="-1")
number_slider_3 = Slider(2, range=0..10)
Y_24 = UnitY(Factor="-0.5")
X_12 = UnitX(Factor="-0.5")
swatch_9 = ColourSwatch(SwatchColor=RGB(107, 107, 107))
swatch_10 = ColourSwatch(SwatchColor=RGB(107, 107, 107))
addition_14 = Addition(A=X_11, B=Y_23)
swatch_11 = ColourSwatch(SwatchColor=RGB(164, 199, 68))
swatch_12 = ColourSwatch(SwatchColor=RGB(148, 90, 72))
multiplication_31 = Multiplication(A=split_8.ListA, B="10")
Y_25 = UnitY(Factor="1.5")
swatch_13 = ColourSwatch(SwatchColor=RGB(83, 109, 194))
concat_23 = Concatenate(FragmentA="this model: ", FragmentC=multiplication_31, FragmentB="mm")

# ---- group: X (deflection, mm)
multiplication_32 = Multiplication(A=num_5, B="10")

# ----
sort_5 = SortList(Keys=multiplication_32)  # -> Keys, ValuesA
rev_8 = ReverseList(List=sort_5.Keys)
pt_14 = ConstructPoint(XCoordinate=multiplication_32, YCoordinate=series_2, ZCoordinate=0)
item_11 = ListItem(List=rev_8, Index=0, Wrap=True)
round_4 = Round(Number=item_11)  # -> Nearest, Floor, Ceiling
pline_4 = PolyLine(Vertices=pt_14, Closed=False)
max_2 = Maximum(A=round_4.Ceiling, B=experimenntal_deflection_at_9_702kn_2)
division_8 = Division(A=round_4.Ceiling, B=x_grid_spacing_2)
addition_15 = Addition(A=max_2, B="1")
rectangle_2 = Rectangle(Plane=PlaneXY(0, 0, 0), XSize=addition_15, YSize=addition_13, Radius=0)  # -> Rectangle, Length
series_9 = Series(Start=0, Step=x_grid_spacing_2, Count=expr("x+2", division_8))
pt_15 = ConstructPoint(XCoordinate=series_9, YCoordinate=0, ZCoordinate=0)
X_13 = UnitX(Factor=addition_15)
move_14 = Move(Geometry=pt_15, Motion=Y_22)  # -> Geometry, Transform
move_15 = Move(Geometry=pt_12, Motion=X_13)  # -> Geometry, Transform
ln_7 = Line(StartPoint=pt_15, EndPoint=move_14.Geometry)
ln_8 = Line(StartPoint=pt_12, EndPoint=move_15.Geometry)
entwine_19 = Entwine(
    Branch00=pline_4,
    Branch01=pt_14,
    Branch02=pline_3,
    Branch03=pt_13,
    Branch04=pt_12,
    Branch05=ln_8,
    Branch06=pt_15,
    Branch07=ln_7,
    Branch08=rectangle_2.Rectangle,
    FlattenInputs=True)
scale_nu_2 = ScaleNU(Geometry=entwine_19, Plane=PlaneXY(0, 0, 0), ScaleX=x_axis_factor_2, ScaleY=y_axis_factor_2, ScaleZ=1)  # -> Geometry, Transform
bang_5 = ExplodeTree(Data=scale_nu_2.Geometry)  # -> Branch0, Branch1, Branch2, Branch3, Branch4, Branch5, Branch6, Branch7, Branch8
drec_3 = DeconstuctRectangle(Rectangle=bang_5.Branch8)  # -> BasePlane, XInterval, YInterval
drec_4 = DeconstuctRectangle(Rectangle=bang_5.Branch8)  # -> BasePlane, XInterval, YInterval
pt_16 = ConstructPoint(XCoordinate=drec_3.XInterval, YCoordinate=drec_3.YInterval, ZCoordinate=0)
pt_17 = ConstructPoint(XCoordinate=drec_4.XInterval, YCoordinate=drec_4.YInterval, ZCoordinate=0)
move_16 = Move(Geometry=pt_16, Motion=X_10)  # -> Geometry, Transform
move_17 = Move(Geometry=bang_5.Branch4, Motion=X_12)  # -> Geometry, Transform
item_12 = ListItem(List=move_17.Geometry, Index="6", Wrap=True)
move_18 = Move(Geometry=item_12, Motion=X_12)  # -> Geometry, Transform
move_19 = Move(Geometry=bang_5.Branch6, Motion=Y_24)  # -> Geometry, Transform
lng_3 = ListLength(List=move_19.Geometry)  # -> expr("x/2", Length)
item_13 = ListItem(List=move_19.Geometry, Index=lng_3, Wrap=True)
move_20 = Move(Geometry=item_13, Motion=Y_24)  # -> Geometry, Transform
move_21 = Move(Geometry=pt_17, Motion=addition_14)  # -> Geometry, Transform
pt_18 = ConstructPoint(XCoordinate=expr("x/2", drec_4.XInterval), YCoordinate=drec_4.YInterval, ZCoordinate=0)
move_22 = Move(Geometry=pt_18, Motion=Y_25)  # -> Geometry, Transform
move_23 = Move(Geometry=move_22.Geometry, Motion=Y_25)  # -> Geometry, Transform
move_24 = Move(Geometry=move_23.Geometry, Motion=Y_25)  # -> Geometry, Transform

preview_6 = CustomPreview(Geometry=[bang_5.Branch0, bang_5.Branch1], Material=swatch_12)
preview_7 = CustomPreview(Geometry=[bang_5.Branch2, bang_5.Branch3], Material=swatch_11)
preview_8 = CustomPreview(Geometry=bang_5.Branch5, Material=swatch_9)
preview_9 = CustomPreview(Geometry=bang_5.Branch7, Material=swatch_10)
preview_10 = CustomPreview(Geometry=bang_5.Branch8, Material=ColourSwatch(SwatchColor=RGB(0, 0, 0)))
tag_10 = TextTag3D(Location=move_16.Geometry, Text="Numerical model curve", Size="1", Colour=swatch_12, Justification="1")
tag_11 = TextTag3D(Location=move_21.Geometry, Text="Villegas model curve", Size="1", Colour=swatch_11, Justification="1")
tag_12 = TextTag3D(Location=move_24.Geometry, Text="At 7.063kN service load", Size=1, Colour=swatch_13, Justification="5")
tag_13 = TextTag3D(Location=move_23.Geometry, Text="Villegas: 11.4mm", Size=1, Colour=swatch_13, Justification="5")
tag_14 = TextTag3D(Location=move_22.Geometry, Text=concat_23, Size=1, Colour=swatch_13, Justification="5")
tag_15 = TextTag3D(Location=move_17.Geometry, Text=series_7, Size="0.3", Colour=swatch_9, Justification=Slider(4, range=0..10))
tag_16 = TextTag3D(Location=move_18.Geometry, Text="Load (kN)", Size="0.6", Colour=swatch_9, Justification=Slider(3, range=0..10))
tag_17 = TextTag3D(Location=move_19.Geometry, Text=series_9, Size="0.3", Colour=swatch_10, Justification=number_slider_3)
tag_18 = TextTag3D(Location=move_20.Geometry, Text="max displacement (cm)", Size="0.6", Colour=swatch_10, Justification=number_slider_3)

# ==== cluster FirstLastElt
L = ClusterInput()
lng = ListLength(List=L)  # -> expr("x-1", Length)
entwine = Entwine(Branch00="0", Branch01=lng, FlattenInputs=True)  # -> flatten(Result)
python = GhPythonScript(indices=entwine, L=lng)  # -> out, a; inputs indices: list of Int32, L: Int32
# ---------- python: Python ----------
__author__ = "ilemaitre"
__version__ = "2020.07.04"

import rhinoscriptsyntax as rs

a = [False for i in range(L+1)]
for x in indices:
    a[x]=True
# ---------- end python ----------
a = ClusterOutput(python.a)
